# Grasshopper definition 02_pick_and_place.ghx (Grasshopper 1.0.7)

pt = Point(Point(-0.2645402599, -0.614961153, 0.31808586))
xz_plane = XZPlane(Origin=pt)

# ----
# 1. COMPAS FAB - Define Robotic Set Up
# 1. Load robot from ROS
connect = BooleanToggle(True)
ros = ROSConnect(connect=connect)  # -> ros_client, is_connected; inputs port: Int32, connect: Boolean
#   port ip: The ip address ROS. Defaults to 127.0.0.1.
#   port port: The port of ROS. Defaults to 9090.
#   port connect: If True, connects to ROS. If False, disconnects from ROS. Defaults to False.
#   port ros_client: The ROS client.
#   port is_connected: True if connection established.
# ---------- ros: Python ----------
"""
Connect or disconnect to ROS.

COMPAS FAB v0.27.0
"""
from ghpythonlib.componentbase import executingcomponent as component
from scriptcontext import sticky as st

from compas_fab.backends import RosClient
from compas_fab.ghpython.components import create_id


class ROSConnect(component):
    def RunScript(self, ip, port, connect):
        ros_client = None

        ip = ip or '127.0.0.1'
        port = port or 9090

        key = create_id(self, 'ros_client')
        ros_client = st.get(key, None)

        if ros_client:
            st[key].close()
        if connect:
            st[key] = RosClient(ip, port)
            st[key].run(5)

        ros_client = st.get(key, None)
        is_connected = ros_client.is_connected if ros_client else False
        return (ros_client, is_connected)
# ---------- end ros ----------
load_robot = BooleanToggle(True)
compas_fab_ros_robot = COMPASFABROSRobot(ros_client=ros.ros_client, load=load_robot)  # -> robot; inputs load: Boolean
#   port ros_client: The ROS client.
#   port load: If True, loads the robot from ROS. Defaults to False.
# ---------- compas_fab_ros_robot: Python ----------
"""
Load robot directly from ROS.

COMPAS FAB v1.0.2
"""

from compas.scene import SceneObject
from ghpythonlib.componentbase import executingcomponent as component
from scriptcontext import sticky as st

from compas_fab.ghpython.components import create_id


class ROSRobot(component):
    def RunScript(self, ros_client, load):
        key = create_id(self, "robot")

        if ros_client and ros_client.is_connected and load:
            # Load URDF from ROS
            st[key] = ros_client.load_robot(load_geometry=True, precision=12)
            st[key].scene_object = SceneObject(st[key].model)

        robot = st.get(key, None)
        if robot:  # client sometimes need to be restarted, without needing to reload geometry
            robot.client = ros_client
        return robot
# ---------- end compas_fab_ros_robot ----------
robot = Data(compas_fab_ros_robot)

# ----
# 3) Define Motion Start Frame
pt_2 = Point(Point(0.4611055951, -0.5009483873, 1.352769955))
xy = XYPlane(Origin=pt_2)
pflip = FlipPlane(Plane=xy, ReverseX=False, ReverseY=False, SwapAxes=True)
pickup_plane = Data(pflip)

# ----
# 3) Define Motion End Frame
pt_3 = Point(Point(0.5970484833, 0.1824378657, 1.167899985))
xy_2 = XYPlane(Origin=pt_3)
pflip_2 = FlipPlane(Plane=xy_2, ReverseX=False, ReverseY=False, SwapAxes=True)
pickup_plane_2 = Data(pflip_2)

# ----
# 4. COMPAS FAB - Robotic Planning Pick & Place
# 3) Define pick-up plane
pt_4 = Point(Point(0.8993404864, -0.226571388, 0.02344175302))
xy_3 = XYPlane(Origin=pt_4)
pflip_3 = FlipPlane(Plane=xy_3, ReverseX=False, ReverseY=False, SwapAxes=True)
pickup_plane_3 = Data(pflip_3)

# ----
# 2. Attach tool and robot table
robot_2 = ValueList({"ur3": 0, "ur5": 1, "ur10e": 2, "ur20": 3}, selected="ur20")
load = BooleanToggle(True)
robot_3 = Data(robot)
ghpython_script = GhPythonScript(ee_name="test_end_effector", robot=robot_2, load=load)  # -> visual_mesh, collision_mesh, tcf_plane; inputs robot: Int32, load: Boolean
# ---------- ghpython_script: Python ----------
from compas_rhino.conversions import frame_to_rhino_plane, mesh_to_rhino
from compas.data import json_load
import os
import sys

canvas = ghenv.Component.OnPingDocument()
path = canvas.FilePath
dir_path = os.path.dirname(path)
robots = ["ur3", "ur5", "ur10e", "ur20"]
robot = robots[robot]
ee_path = os.path.join(dir_path, "fabrication", "setup", "endeffectors", robot, ee_name + ".json")

if (ee_name, robot):
    ee_dict = json_load(ee_path)
    
    tcf_plane = frame_to_rhino_plane(ee_dict["tcf"])
    visual_mesh = mesh_to_rhino(ee_dict["visual_mesh"])
    
    if 'collision_mesh' in ee_dict:
        collision_mesh = mesh_to_rhino(ee_dict["collision_mesh"])
    else:
        collision_mesh = None

else:
    ghenv.Component.Message("Missing EE Info")
# ---------- end ghpython_script ----------
compas_fab_attached_tool = COMPASFABAttachedTool(
    robot=robot_3,
    visual_mesh=ghpython_script.visual_mesh,
    collision_mesh=ghpython_script.collision_mesh,
    tcf_plane=ghpython_script.tcf_plane)  # -> robot; inputs visual_mesh: Mesh, collision_mesh: Mesh
#   port visual_mesh: A visual mesh for the tool.
#   port collision_mesh: A collision mesh for the tool.
#   port tcf_plane: The frame of the tool in tool0 frame.
#   port group: The planning group to which the tool should be attached.
#   port connected_to: The link to which the tool should be connected to.
# ---------- compas_fab_attached_tool: Python ----------
"""
Attach a tool to the robot.

COMPAS FAB v1.0.2
"""

from compas.geometry import Frame
from compas_rhino.conversions import mesh_to_compas
from compas_rhino.conversions import plane_to_compas_frame
from ghpythonlib.componentbase import executingcomponent as component

from compas_fab.robots import Tool


class AttachToolComponent(component):
    def RunScript(self, robot, visual_mesh, collision_mesh, tcf_plane, group, connected_to):
        if robot and robot.client and robot.client.is_connected and visual_mesh:
            if not collision_mesh:
                collision_mesh = visual_mesh

            c_visual_mesh = mesh_to_compas(visual_mesh)
            c_collision_mesh = mesh_to_compas(collision_mesh)

            if not tcf_plane:
                frame = Frame.worldXY()
            else:
                frame = plane_to_compas_frame(tcf_plane)
            tool = Tool(c_visual_mesh, frame, c_collision_mesh, connected_to=connected_to)

            robot.attach_tool(tool, group)

        return robot
# ---------- end compas_fab_attached_tool ----------
robot_4 = Data(compas_fab_attached_tool)

compas_fab_zero_config = COMPASFABZeroConfig(robot=robot_4)  # -> config
#   port group: If assigned, it will return the zero configuration for the given group, otherwise a full zero configuration.
#   port config: The zero configuration.
# ---------- compas_fab_zero_config: Python ----------
"""
Get a zero configuration for a robot.

COMPAS FAB v1.0.2
"""

from ghpythonlib.componentbase import executingcomponent as component


class ConfigZero(component):
    def RunScript(self, robot, group):
        if robot:
            return robot.zero_configuration(group)

        return None
# ---------- end compas_fab_zero_config ----------

# ----
# 3. Attach Robot Table
panel = Panel("table_test.obj")
show = BooleanToggle(False)
tool = PythonScript(file_name=panel, show=show)  # -> mesh, vis
# ---------- tool: Python ----------
import os, math
import sys
from compas.datastructures import Mesh
from compas.data import json_load
from compas.scene import SceneObject

canvas = ghenv.Component.OnPingDocument()
path = canvas.FilePath
dir_path = os.path.dirname(path)
table_dir_path = os.path.join(dir_path, "fabrication", "setup", "table")
mesh_path = os.path.join(table_dir_path, file_name)

if file_name.endswith(".obj"):
    mesh = Mesh.from_obj(mesh_path)
    print (type(mesh))
elif file_name.endswith(".json"):
    mesh = json_load(mesh_path)
    print (type(mesh))
else:
    raise Exception("The filetype of {} is not currently importable".format(file_name))

if show:
    vis = SceneObject(mesh).draw()
# ---------- end tool ----------
table = GhPythonScript(robot=robot_3, mesh=tool.mesh, add=Button())
# ---------- table: Python ----------
from compas_fab.robots import PlanningScene
from compas_fab.robots import CollisionMesh
from compas_rhino.conversions import mesh_to_compas
from compas.data import json_dump,json_dumps
if robot:
    if add:
        scene = PlanningScene(robot)
        scene.remove_collision_mesh("table")
        cm = CollisionMesh(mesh, "table")
        scene.add_collision_mesh(cm)
# ---------- end table ----------

# ----
# 3. COMPAS FAB - Current Config to End Plane
# 6) Plan trajectories From Current Config to End Plane
robot_5 = Data(robot_4)
end_plane = Data(xz_plane)
current_config = Data(compas_fab_zero_config)
plan_trajectories = GhPythonScript(robot=robot_5, current_config=current_config, end_plane=end_plane, compute=Toggle(True))  # -> motion_end_config, motion_trajectory, motion_trajectory_frames; inputs compute: Boolean
# ---------- plan_trajectories: Python ----------
"""
Calculate pickup trajectory of a part.
"""
import math
from ghpythonlib.componentbase import executingcomponent as component
from scriptcontext import sticky as st

#from compas.artists import Artist
from compas.scene import Scene
from compas.geometry import Frame
from compas.geometry import Transformation
from compas_rhino.conversions import plane_to_compas_frame, frame_to_rhino_plane
from compas_fab.ghpython.components import create_id
from compas_fab.robots import AttachedCollisionMesh
from compas_fab.robots import CollisionMesh
from compas_fab.robots import PlanningScene

#from helpers import get_assembly_sequence

class PlanPartPickupTrajectory(component):
    def RunScript(self, robot, group, current_config, end_plane, planner_id, compute):
        self.Message = ""

        motion_trajectory = None
        motion_frames = []

        # Clean scene
        if compute and robot and robot.client and robot.client.is_connected:
            scene = PlanningScene(robot)

        if not current_config or not end_plane:
            self.Message = "No approach & current configs defined"
            return motion_end_config, motion_trajectory, motion_frames

        if compute and current_config and end_plane:
            end_frame = plane_to_compas_frame(end_plane)
            try:
                motion_end_config = robot.inverse_kinematics(end_frame, current_config, group)
            except:
                raise Exception("Could solve IK solution for End Config")
                return motion_end_config, motion_trajectory, motion_frames

        # Compute MOVE trajectory
        if compute and robot and robot.client and robot.client.is_connected:
            planner_id = planner_id or 'TRRT'

            tolerance_above = self._generate_default_tolerances(robot.get_configurable_joints(group))
            tolerance_below = self._generate_default_tolerances(robot.get_configurable_joints(group))
            goal_constraints = robot.constraints_from_configuration(
                configuration=motion_end_config,
                tolerances_above=tolerance_above,
                tolerances_below=tolerance_below,
                group=group
            )

            trajectory = robot.plan_motion(goal_constraints,
                                               start_configuration=current_config,
                                               group=group,
                                               options=dict(
                                               planner_id=planner_id,
    #                                               attached_collision_meshes=attached_collision_meshes
                                               ))

            motion_trajectory = trajectory

        if motion_trajectory:
            for c in motion_trajectory.points:
                frame = robot.forward_kinematics(c, group, options=dict(solver='model'))
                motion_frames.append(frame_to_rhino_plane(frame))

        if motion_trajectory:
            self.Message = "Found Motion trajectory  ({} points)".format(len(motion_trajectory.points))

        return motion_end_config, motion_trajectory, motion_frames

    def _generate_default_tolerances(self, joints):
        DEFAULT_TOLERANCE_METERS = .001
        DEFAULT_TOLERANCE_RADIANS = math.radians(1)

        return [
            DEFAULT_TOLERANCE_METERS if j.is_scalable()
            else DEFAULT_TOLERANCE_RADIANS
            for j in joints
        ]
# ---------- end plan_trajectories ----------
trajectory_planes = Data(plan_trajectories.motion_trajectory_frames)
trajectory = Data(plan_trajectories.motion_trajectory)

# ----
# 3) Define Motion End Frame
pt_5 = Point(Point(0.35018877, -0.4559631553, 0.9483085116))
xy_4 = XYPlane(Origin=pt_5)
pflip_4 = FlipPlane(Plane=xy_4, ReverseX=False, ReverseY=False, SwapAxes=True)
pickup_plane_4 = Data(pflip_4)

# ----
# Define Place Plane
unit_y = UnitY(Factor=1)
unit_x = UnitX(Factor=1)
point = Point(Point(1.468429082, -0.0446567426, 0))
construct_plane = ConstructPlane(Origin=point, XAxis=unit_y, YAxis=unit_x)

yz_plane = YZPlane(Origin=pt_3)
yz_plane_2 = YZPlane(Origin=pt_2)

# ----
# 4) Solve all IK
# Results in 4 configurations
max_step = Slider(0.08, range=0..0.1)
number_slider = Slider(0.15, range=0..1)
robot_6 = Data(robot_4)
pickup_plane_5 = Data(pickup_plane_3)
plan_pickup = GhPythonScript(
    robot=robot_6,
    max_step=max_step,
    pick_plane=pickup_plane_5,
    approach_distance=number_slider,
    flip_offset_plane=Toggle(True),
    update=Button())  # -> pick_config, approach_pick_config, pick_trajectory, pick_trajectory_planes; inputs flip_offset_plane: Boolean
# ---------- plan_pickup: Python ----------
"""
Calculate pickup of a part.
"""
from ghpythonlib.componentbase import executingcomponent as component
from scriptcontext import sticky as st

#from compas.artists import Artist
from compas.scene import Scene
from compas.geometry import Frame
from compas.geometry import Transformation
from compas_rhino.conversions import plane_to_compas_frame, frame_to_rhino_plane
from compas_fab.ghpython.components import create_id
from compas_fab.robots import PlanningScene
from compas.geometry import scale_vector, add_vectors

class PickPart(component):
    def RunScript(self, robot, group, start_configuration, max_step, pick_plane, approach_distance, flip_offset_plane, update):
        self.Message = ""

        pick_config = None
        approach_pick_config = None
        pick_trajectory = None
        pick_trajectory_frames = []

        if pick_plane:
            pick_frame = plane_to_compas_frame(pick_plane)

        if approach_distance > 0:
            approach_pick_frame = self._offset_approach_frame(pick_frame, approach_distance, flip_offset_plane)

        
        if (update or not pick_config or not approach_pick_config) and robot and robot.client and robot.client.is_connected:
            scene = PlanningScene(robot)
            scene.remove_collision_mesh("parts")
#            geo_scene = Scene()
            
            try:
                pick_config = robot.inverse_kinematics(pick_frame, start_configuration, group)
            except:
                raise Exception("Could not solve IK solution for pick config")
            try:
                approach_pick_config = robot.inverse_kinematics(approach_pick_frame, pick_config, group)
            except:
                raise Exception("Could not solve IK solution for approach pick config")

        # Compute PICK trajectory
        if approach_pick_config and pick_config:
            max_step = max_step
            print (max_step)
            frames = [
                       robot.forward_kinematics(c, group, options=dict(solver='model'))
                       for c in (approach_pick_config, pick_config)
                     ]

            trajectory = robot.plan_cartesian_motion(frames,
                                                     start_configuration=approach_pick_config,
                                                     group=group,
                                                     options=dict(
                                                         max_step=max_step,
                                                     ))
            if trajectory.fraction < 1:
                raise Exception("Incomplete cartesian trajectory found. Only {:.1f}% of the trajectory could be planned".format(trajectory.fraction * 100))

            # Only assign if fraction is full
            pick_trajectory = trajectory

            #if place trajectory calculate frames
            if pick_trajectory:
                for c in pick_trajectory.points:
                    frame = robot.forward_kinematics(c, group, options=dict(solver='model'))
#                    pick_trajectory_frames.append(geo_scene.add(frame))
#                    pick_trajectory_frames = geo_scene.draw() #TEST
                    pick_trajectory_frames.append(frame_to_rhino_plane(frame))

        self.Message = "Found pick up configurations\nusing {:.2f}m approach distance".format(approach_distance)
        return pick_config, approach_pick_config, pick_trajectory, pick_trajectory_frames
    
    def _offset_approach_frame(self, frame, approach_distance, flip_offset_plane):
        
        frame = frame.copy()
        offset_frame = frame.copy()
            
        if approach_distance > 0:
            frame_normal = offset_frame.normal
            frame_normal_scaled = scale_vector(-frame_normal, approach_distance)
            if(flip_offset_plane):
                frame_normal_scaled = scale_vector(-frame_normal, approach_distance)
            new_frame_origin = add_vectors(offset_frame.point, frame_normal_scaled)
            offset_frame = Frame(new_frame_origin, offset_frame.xaxis, offset_frame.yaxis)
        
        return offset_frame
# ---------- end plan_pickup ----------
plan_place = GhPythonScript(
    robot=robot_6,
    approach_pick_config=plan_pickup.approach_pick_config,
    place_plane=construct_plane,
    approach_distance=number_slider,
    flip_offset_plane=Toggle(True),
    update=Button())  # -> place_config, approach_place_config; inputs flip_offset_plane: Boolean
# ---------- plan_place: Python ----------
"""
Calculate placement of a part.
"""
from ghpythonlib.componentbase import executingcomponent as component
from scriptcontext import sticky as st

#from compas.artists import Artist
from compas.scene import Scene
from compas.geometry import Frame
from compas.geometry import Transformation
from compas_rhino.conversions import plane_to_compas_frame
from compas_fab.ghpython.components import create_id
from compas_fab.robots import PlanningScene
from compas.geometry import scale_vector, add_vectors

class PlacePart(component):
    def RunScript(self, robot, group, approach_pick_config, place_plane, approach_distance, flip_offset_plane, update):
        self.Message = ""
        if not place_plane:
            raise Exception("No place plane defined")

        place_config = None
        approach_place_config = None
        
        if (update or not place_config or not approach_place_config) and robot and robot.client and robot.client.is_connected:
            scene = PlanningScene(robot)
            scene.remove_collision_mesh("parts")
            geo_scene = Scene()

            place_frame = plane_to_compas_frame(place_plane)
            approach_place_frame = place_frame.copy()
            if approach_distance > 0:
                approach_place_frame = self._offset_approach_frame(place_frame, approach_distance, flip_offset_plane)

            try:
                place_config = robot.inverse_kinematics(place_frame, approach_pick_config, group)
            except:
                raise Exception("Could solve IK solution for place config")
            try:
                approach_place_config = robot.inverse_kinematics(approach_place_frame, place_config, group)
            except:
                raise Exception("Could not solve IK solution for approach place config")

        self.Message = "Found place configurations\nusing {:.2f}m approach distance".format(approach_distance)
        return place_config, approach_place_config
    
    def _offset_approach_frame(self, frame, approach_distance, flip_offset_plane):
        
        frame = frame.copy()
        offset_frame = frame.copy()
            
        if approach_distance > 0:
            frame_normal = offset_frame.normal
            frame_normal_scaled = scale_vector(-frame_normal, approach_distance)
            if(flip_offset_plane):
                frame_normal_scaled = scale_vector(-frame_normal, approach_distance)
            new_frame_origin = add_vectors(offset_frame.point, frame_normal_scaled)
            offset_frame = Frame(new_frame_origin, offset_frame.xaxis, offset_frame.yaxis)
        
        return offset_frame
# ---------- end plan_place ----------
pickup_config = Data(plan_pickup.pick_config)
approach_pickup_config = Data(plan_pickup.approach_pick_config)
approach_place_config = Data(plan_place.approach_place_config)
place_config = Data(plan_place.place_config)

# ----
# 6) Plan Pick & Place trajectories
toggle = BooleanToggle(True)
robot_7 = Data(robot_4)
plan_trajectories_2 = GhPythonScript(
    robot=robot_7,
    max_step=max_step,
    approach_pick_config=plan_pickup.approach_pick_config,
    approach_place_config=plan_place.approach_place_config,
    place_config=plan_place.place_config,
    compute=toggle)  # -> place_trajectory, place_trajectory_frames, move_trajectory, move_trajectory_frames; inputs compute: Boolean
# ---------- plan_trajectories_2: Python ----------
"""
Calculate pickup trajectory of a part.
"""
import math
from ghpythonlib.componentbase import executingcomponent as component
from scriptcontext import sticky as st

#from compas.artists import Artist
from compas.scene import Scene
from compas.geometry import Frame
from compas.geometry import Transformation
from compas_rhino.conversions import plane_to_compas_frame, frame_to_rhino_plane
from compas_fab.ghpython.components import create_id
from compas_fab.robots import AttachedCollisionMesh
from compas_fab.robots import CollisionMesh
from compas_fab.robots import PlanningScene

#from helpers import get_assembly_sequence

class PlanPartPickupTrajectory(component):
    def RunScript(self, robot, group, max_step, approach_pick_config, approach_place_config, place_config, planner_id, compute):
        self.Message = ""

        
        place_trajectory = None
        move_trajectory = None

        pick_trajectory_frames = []
        place_trajectory_frames = []
        move_trajectory_frames = []

        # Clean scene
        if compute and robot and robot.client and robot.client.is_connected:
            scene = PlanningScene(robot)
            scene.remove_collision_mesh("parts")

        # TODO: ADD COLLISION MESHES

        if not approach_place_config or not place_config or not approach_pick_config:
            self.Message = "No approach & place configs defined"
            return place_trajectory, place_trajectory_frames, move_trajectory, move_trajectory_frames

        # Compute PLACE trajectory
        if compute and robot and robot.client and robot.client.is_connected:
            max_step = max_step
            frames = [
                       robot.forward_kinematics(c, group, options=dict(solver='model'))
                       for c in (approach_place_config, place_config)
                     ]

            # TODO: Add brick
            # attached_collision_meshes = []
            trajectory = robot.plan_cartesian_motion(frames,
                                                     start_configuration=approach_place_config,
                                                     group=group,
                                                     options=dict(
                                                         max_step=max_step,
    #                                                         attached_collision_meshes=attached_collision_meshes
                                                     ))
            if trajectory.fraction < 1:
                raise Exception("Incomplete cartesian trajectory found. Only {:.1f}% of the trajectory could be planned".format(trajectory.fraction * 100))

            # Only assign if fraction is full
            place_trajectory = trajectory

        if place_trajectory:
            for c in place_trajectory.points:
                frame = robot.forward_kinematics(c, group, options=dict(solver='model'))
                place_trajectory_frames.append(frame_to_rhino_plane(frame))

        # Compute MOVE trajectory
        if compute and robot and robot.client and robot.client.is_connected:
            planner_id = planner_id or 'TRRT'

            # TODO: Add brick
            # attached_collision_meshes = []

            tolerance_above = self._generate_default_tolerances(robot.get_configurable_joints(group))
            tolerance_below = self._generate_default_tolerances(robot.get_configurable_joints(group))
            goal_constraints = robot.constraints_from_configuration(
                configuration=approach_place_config,
                tolerances_above=tolerance_above,
                tolerances_below=tolerance_below,
                group=group
            )

            trajectory = robot.plan_motion(goal_constraints,
                                               start_configuration=approach_pick_config,
                                               group=group,
                                               options=dict(
                                               planner_id=planner_id,
    #                                               attached_collision_meshes=attached_collision_meshes
                                               ))

            move_trajectory = trajectory

        if move_trajectory:
            for c in move_trajectory.points:
                frame = robot.forward_kinematics(c, group, options=dict(solver='model'))
                move_trajectory_frames.append(frame_to_rhino_plane(frame))

        if place_trajectory and move_trajectory:
            self.Message = "Found move and place trajectories ({} points)".format(len(place_trajectory.points) + len(move_trajectory.points))

        return place_trajectory, place_trajectory_frames, move_trajectory, move_trajectory_frames

    def _generate_default_tolerances(self, joints):
        DEFAULT_TOLERANCE_METERS = .001
        DEFAULT_TOLERANCE_RADIANS = math.radians(1)

        return [
            DEFAULT_TOLERANCE_METERS if j.is_scalable()
            else DEFAULT_TOLERANCE_RADIANS
            for j in joints
        ]
# ---------- end plan_trajectories_2 ----------
ghpython_script_2 = GhPythonScript(
    pick_trajectory=plan_pickup.pick_trajectory,
    place_trajectory=plan_trajectories_2.place_trajectory,
    move_trajectory=plan_trajectories_2.move_trajectory)  # -> trajectory
# ---------- ghpython_script_2: Python ----------
from compas_fab.robots import JointTrajectory

if (pick_trajectory and place_trajectory and move_trajectory):
    trajectory_points = pick_trajectory.points + move_trajectory.points + place_trajectory.points
    trajectory = JointTrajectory(trajectory_points)
    ghenv.Component.Message = None
else:
    ghenv.Component.Message = "Missing a Trajectory"
# ---------- end ghpython_script_2 ----------
place_trajectory = Data(plan_trajectories_2.place_trajectory)
move_trajectory = Data(plan_trajectories_2.move_trajectory)

pick_trajectory = Data(plan_pickup.pick_trajectory)

# ----
# Pick and Place
value_list = ValueList({"0. current config": 0, "1. Approach pickup config": 1, "2. Pickup config": 2, "3. Approach place config": 3, "4. Place config": 4, "5. Trajectory": 5, "6. Pick Trajectory": 6, "7. Move Trajectory": 7, "8. PlaceTrajectory": 8}, selected="5. Trajectory")
stream_filter = StreamFilter(
    Gate=value_list,
    Stream0=compas_fab_zero_config,
    Stream1=approach_pickup_config,
    Stream2=pickup_config,
    Stream3=approach_place_config,
    Stream4=place_config,
    Stream5=ghpython_script_2,
    Stream6=pick_trajectory,
    Stream7=move_trajectory,
    Stream8=place_trajectory)

panel_2 = Panel("5")

number_slider_2 = Slider(0.1, range=0..1)
number_slider_3 = Slider(0.04, range=0..3.14)
# Exit Pick & Place
number_slider_4 = Slider(0.006, range=0..3.14)

ghpython_script_3 = GhPythonScript(trajectory=trajectory)  # -> last_config
# ---------- ghpython_script_3: Python ----------
from compas_robots import Configuration

points = trajectory.points

config = points[-1]

config.values

points = Configuration.from_revolute_values(config.values())
# ---------- end ghpython_script_3 ----------

# ----
# URRTDE - Send Robotic Comands
# Additional Robotic Control
panel_4 = Panel("192.168.131.41")

# ----
# IP
panel_5 = Panel("192.168.0.210")

# ----
# Get Current Config
button = Button()
# FIXED
get_config = GhPythonScript(robot=robot_4, send=button, ip=panel_5)  # -> config, frame
# ---------- get_config: Python ----------
import os
from scriptcontext import sticky as st
#sticky is a persistent dictionary which can save values and also be acessed by other GH components
#we use it here with a custom key to store values we read from the robot
from compas.rpc import Proxy
from compas.geometry import Frame
package_path = ghdoc.Path

config_key = 'config_{}'.format(str(ghenv.Component.InstanceGuid))
new_key = 'new_key_{}'.format(str(ghenv.Component.InstanceGuid))
frame_key = 'frame_{}'.format(str(ghenv.Component.InstanceGuid))

if config_key not in st:
    st[config_key] = None

if frame_key not in st:
    st[frame_key] = None

if send:
    canvas = ghenv.Component.OnPingDocument()
    path = os.path.abspath(os.path.join(package_path,"../fabrication", "control"))
    print (path)
    rtde = Proxy('fabrication', path=path)
    st[config_key] = rtde.get_config(ip=ip)
    st[new_key] = rtde.get_config(ip=ip)
    st[frame_key] = robot.forward_kinematics(st[config_key], group, options=dict(solver='model'))
#    a = rtde.get_config(ip=ip)

config = st[config_key]
frame = st[frame_key]

#print "joint values: ", config.joint_values

#frame_WCF = frame_RCF.transformed(robot.transformation_BCF_WCF())
#print frame_RCF
# ---------- end get_config ----------
draw = Draw(cg=get_config.frame)  # -> rg
#   port cg: The COMPAS geometry or datastructure to be drawn.
#   port rg: The Rhino geometry object.
# ---------- draw: Python ----------
"""
Draws COMPAS geometry in Grasshopper.
"""
from ghpythonlib.componentbase import executingcomponent as component

from compas_rhino.conversions import frame_to_rhino_plane


class CompasToRhinoGeometry(component):
    def RunScript(self, cg):
        if not cg:
            return None

        return frame_to_rhino_plane(cg)
# ---------- end draw ----------

# ----
# 5) Solve IK for Planes
data = Data(get_config.config)
start_plane = Data(yz_plane_2)
robot_8 = Data(robot_4)
end_plane_2 = Data(yz_plane)
plan_place_2 = GhPythonScript(robot=robot_8, current_config=compas_fab_zero_config, start_plane=start_plane, end_plane=end_plane_2, update=Button())  # -> motion_start_config, motion_end_config
# ---------- plan_place_2: Python ----------
"""
Calculate placement of a part.
"""
from ghpythonlib.componentbase import executingcomponent as component
from scriptcontext import sticky as st

#from compas.artists import Artist
from compas.scene import Scene
from compas.geometry import Frame
from compas.geometry import Transformation
from compas_rhino.conversions import plane_to_compas_frame
from compas_fab.ghpython.components import create_id
from compas_fab.robots import PlanningScene
from compas.geometry import scale_vector, add_vectors

class PlacePart(component):
    def RunScript(self, robot, group, current_config, start_plane, end_plane, update):
        self.Message = ""
        if not end_plane:
            raise Exception("No place plane defined")

        place_config = None
        approach_place_config = None
        
        if (update or not place_config or not approach_place_config) and robot and robot.client and robot.client.is_connected:
            scene = PlanningScene(robot)

            start_frame =  plane_to_compas_frame(start_plane)
            end_frame = plane_to_compas_frame(end_plane)

            try:
                motion_start_config = robot.inverse_kinematics(start_frame, current_config, group)
            except:
                raise Exception("Could not solve IK solution for Start Plane")
            try:
                motion_end_config = robot.inverse_kinematics(end_frame, motion_start_config, group)
            except:
                raise Exception("Could solve IK solution for End Config")

        self.Message = "Found Start and End Configs"
        return motion_start_config, motion_end_config
# ---------- end plan_place_2 ----------
place_config_2 = Data(plan_place_2.motion_start_config)
approach_place_config_2 = Data(plan_place_2.motion_end_config)

# ----
# 2. COMPAS FAB - Robotic Planning Current, Config 1, & End Config
place_config_3 = Data(plan_place_2.motion_start_config)
approach_place_config_3 = Data(plan_place_2.motion_end_config)

# ----
# 6) Plan trajectories
robot_9 = Data(robot_4)
plan_trajectories_3 = GhPythonScript(robot=robot_9, motion_start_config=place_config_3, motion_end_config=approach_place_config_3, compute=Toggle(True))  # -> motion_trajectory, motion_trajectory_frames; inputs compute: Boolean
# ---------- plan_trajectories_3: Python ----------
"""
Calculate pickup trajectory of a part.
"""
import math
from ghpythonlib.componentbase import executingcomponent as component
from scriptcontext import sticky as st

#from compas.artists import Artist
from compas.scene import Scene
from compas.geometry import Frame
from compas.geometry import Transformation
from compas_rhino.conversions import plane_to_compas_frame, frame_to_rhino_plane
from compas_fab.ghpython.components import create_id
from compas_fab.robots import AttachedCollisionMesh
from compas_fab.robots import CollisionMesh
from compas_fab.robots import PlanningScene

#from helpers import get_assembly_sequence

class PlanPartPickupTrajectory(component):
    def RunScript(self, robot, group, motion_start_config, motion_end_config, planner_id, compute):
        self.Message = ""

        motion_trajectory = None
        motion_frames = []

        # Clean scene
        if compute and robot and robot.client and robot.client.is_connected:
            scene = PlanningScene(robot)

        if not motion_start_config or not motion_end_config:
            self.Message = "No approach & place configs defined"
            return motion_trajectory, motion_frames

        # Compute MOVE trajectory
        if compute and robot and robot.client and robot.client.is_connected:
            planner_id = planner_id or 'TRRT'

            tolerance_above = self._generate_default_tolerances(robot.get_configurable_joints(group))
            tolerance_below = self._generate_default_tolerances(robot.get_configurable_joints(group))
            goal_constraints = robot.constraints_from_configuration(
                configuration=motion_end_config,
                tolerances_above=tolerance_above,
                tolerances_below=tolerance_below,
                group=group
            )

            trajectory = robot.plan_motion(goal_constraints,
                                               start_configuration=motion_start_config,
                                               group=group,
                                               options=dict(
                                               planner_id=planner_id,
    #                                               attached_collision_meshes=attached_collision_meshes
                                               ))

            motion_trajectory = trajectory

        if motion_trajectory:
            for c in motion_trajectory.points:
                frame = robot.forward_kinematics(c, group, options=dict(solver='model'))
                motion_frames.append(frame_to_rhino_plane(frame))

        if motion_trajectory:
            self.Message = "Found Motion trajectory  ({} points)".format(len(motion_trajectory.points))

        return motion_trajectory, motion_frames

    def _generate_default_tolerances(self, joints):
        DEFAULT_TOLERANCE_METERS = .001
        DEFAULT_TOLERANCE_RADIANS = math.radians(1)

        return [
            DEFAULT_TOLERANCE_METERS if j.is_scalable()
            else DEFAULT_TOLERANCE_RADIANS
            for j in joints
        ]
# ---------- end plan_trajectories_3 ----------
place_trajectory_2 = Data(plan_trajectories_3.motion_trajectory_frames)
move_trajectory_2 = Data(plan_trajectories_3.motion_trajectory)

# ----
# COMPAS FAB - Visualize Robotic Trajectories
# Multiple Configs
value_list_2 = ValueList({"0. current config": 0, "1. motion start config": 1, "2. motion end config": 2, "3. Trajectory": 3}, selected="1. motion start config")
stream_filter_2 = StreamFilter(
    Gate=value_list_2,
    Stream0=get_config.config,
    Stream1=place_config_2,
    Stream2=approach_place_config_2,
    Stream3=move_trajectory_2)

# ----
# Current to End
value_list_3 = ValueList({"0. current config": 0, "1. end config": 1, "2. trajectory": 2}, selected="2. trajectory")
stream_filter_3 = StreamFilter(Gate=value_list_3, Stream0=get_config.config, Stream1=place_config_2, Stream2=move_trajectory_2)

# ----
# Trajectory Visualization
value_list_4 = ValueList({"0. free motion": 0, "1. current to plane trajectory": 1, "2. pick and place": 2}, selected="2. pick and place")
stream_filter_4 = StreamFilter(Gate=value_list_4, Stream0=stream_filter_2, Stream1=stream_filter_3, Stream2=stream_filter)

# ----
# Selection
number_slider_5 = Slider(0, range=0..1)
ghpython_script_4 = GhPythonScript(selected=stream_filter_4, i=number_slider_5)  # -> config
# ---------- ghpython_script_4: Python ----------
import ghpythonlib.components as ghcomp
import compas_fab
from compas_fab.robots.robot import Configuration

def remap(value, source_min, source_max, target_min, target_max):

    normalized_value = (value - source_min) / (source_max - source_min)
    remapped_value = target_min + normalized_value * (target_max - target_min)
    return remapped_value

def trajectory_points_to_configs(trajectory_points):
    configs = [] 
    for trajectory_point in trajectory_points:
        config = Configuration(trajectory_point.joint_values, trajectory_point.joint_types, trajectory_point.joint_names)
        configs.append(config)
    return configs

if isinstance(selected, compas_fab.robots.trajectory.JointTrajectory):
    selected = trajectory_points_to_configs (selected.points)
    index = int(remap(i, 0.001, 1.00, 0, len(selected) - 1))
    index = min(max(0, index), len(selected) - 1)
    result = selected[index]
elif isinstance(selected, Configuration):
    result = selected
else:
    result = None  

config = result
# ---------- end ghpython_script_4 ----------

robot_10 = Data(robot_4)
compas_fab_robot_visualize = COMPASFABRobotVisualize(robot=robot_10, configuration=ghpython_script_4, show_base_frame=Toggle(True))  # -> visual, collision, collision_meshes, attached_meshes, frames, base_frame, ee_frame; inputs show_visual: Boolean, show_collision: Boolean, show_frames: Boolean, show_base_frame: Boolean, show_end_effector_frame: Boolean, show_cm: Boolean, show_acm: Boolean
#   port group: The planning group used for end-effector and base visualization.
#   port configuration: The robot's full configuration.
#   port show_visual: Whether or not to show the robot's visual meshes.
#   port show_collision: Whether or not to show the robot's collision meshes.
#   port show_frames: Whether or not to show the robot's joint frames.
#   port show_base_frame: Whether or not to show the robot's base frame.
#   port show_end_effector_frame: Whether or not to show the robot's end-effector frame.
#   port show_cm: Whether or not to show the collision meshes (if any).
#   port show_acm: Whether or not to show the attached collision meshes (if any).
#   port visual: Rhino meshes of the robot's visual geometry (if any).
#   port collision: Rhino meshes of the robot's collision geometry (if any).
#   port collision_meshes: Rhino meshes of the scene's collision meshes (if any).
#   port attached_meshes: Rhino meshes of the scene's attached collision meshes (if any).
#   port frames: The robot's joint frames as Rhino planes (if any).
#   port base_frame: The robot's base frame as a Rhino plane (if any).
#   port ee_frame: The robot's end-effector frame as a Rhino plane (if any).
# ---------- compas_fab_robot_visualize: Python ----------
"""
Visualizes the robot.

COMPAS FAB v1.0.2
"""

import time

from compas.geometry import Frame
from compas.geometry import Transformation
from compas.scene import SceneObject
from compas_ghpython import create_id
from compas_rhino.conversions import frame_to_rhino_plane
from ghpythonlib.componentbase import executingcomponent as component
from scriptcontext import sticky as st

from compas_fab.backends import BackendFeatureNotSupportedError
from compas_fab.robots import PlanningScene


class RobotVisualize(component):
    def RunScript(
        self,
        robot,
        group,
        configuration,
        show_visual,
        show_collision,
        show_frames,
        show_base_frame,
        show_end_effector_frame,
        show_cm,
        show_acm,
    ):
        visual = None
        collision = None
        collision_meshes = None
        attached_meshes = None
        frames = None
        base_frame = None
        ee_frame = None

        if robot:
            show_visual = True if show_visual is None else show_visual
            show_cm = True if show_cm is None else show_cm
            show_acm = True if show_acm is None else show_acm
            configuration = configuration or robot.zero_configuration()

            robot.update(configuration, visual=show_visual, collision=show_collision)
            compas_frames = robot.transformed_frames(configuration, group)

            if show_visual:
                visual = robot.scene_object.draw_visual()

            if show_collision:
                collision = robot.scene_object.draw_collision()

            if show_base_frame:
                base_compas_frame = compas_frames[0]
                base_frame = frame_to_rhino_plane(base_compas_frame)

            if show_end_effector_frame:
                options = dict(solver="model")
                if robot.attached_tool:
                    options["link"] = robot.attached_tool.connected_to

                ee_compas_frame = robot.forward_kinematics(configuration, group, options=options)
                ee_frame = frame_to_rhino_plane(ee_compas_frame)

            if show_frames:
                frames = []
                for compas_frame in compas_frames[1:]:
                    frame = frame_to_rhino_plane(compas_frame)
                    frames.append(frame)

            cached_scene_key = create_id(self, "cached_scene")

            if show_cm or show_acm:
                cached_scene = st.get(cached_scene_key)
                if not cached_scene:
                    cached_scene = {"time": 0}

                # expire cache if the component has not been executed in the last 2 seconds
                # this allows to slide through a list of configurations
                # without triggering refreshes of the scene in the middle of it
                if time.time() - cached_scene["time"] > 2:
                    update_scene = True
                else:
                    update_scene = False

                if update_scene:
                    scene = PlanningScene(robot)
                    try:
                        scene = robot.client.get_planning_scene()
                    except BackendFeatureNotSupportedError:
                        print(
                            "The selected backend does not support collision meshes. If you need collision mesh support, use a different backend."
                        )
                        scene = None
                        show_cm = False
                        show_acm = False

                if update_scene and show_cm:
                    collision_meshes = []

                    for co in scene.world.collision_objects:
                        header = co.header
                        frame_id = header.frame_id
                        cms = co.to_collision_meshes()

                        for cm in cms:
                            if cm.frame != Frame.worldXY():
                                t = Transformation.from_frame(cm.frame)
                                mesh = cm.mesh.transformed(t)
                            else:
                                mesh = cm.mesh

                            collision_meshes.extend(SceneObject(mesh).draw())

                        cached_scene["cm"] = collision_meshes

                collision_meshes = cached_scene.get("cm", [])

                if update_scene and show_acm:
                    attached_meshes = []

                    for aco in scene.robot_state.attached_collision_objects:
                        for acm in aco.to_attached_collision_meshes():
                            frame_id = aco.object["header"]["frame_id"]
                            frame = robot.forward_kinematics(configuration, options=dict(link=frame_id))
                            t = Transformation.from_frame(frame)

                            # Local CM frame
                            if acm.collision_mesh.frame and acm.collision_mesh.frame != Frame.worldXY():
                                t = t * Transformation.from_frame(acm.collision_mesh.frame)

                            mesh = acm.collision_mesh.mesh.transformed(t)

                            attached_meshes.extend(SceneObject(mesh).draw())

                    cached_scene["acm"] = attached_meshes

                attached_meshes = cached_scene.get("acm", [])

                cached_scene["time"] = time.time()
                st[cached_scene_key] = cached_scene

        return (
            visual,
            collision,
            collision_meshes,
            attached_meshes,
            frames,
            base_frame,
            ee_frame,
        )
# ---------- end compas_fab_robot_visualize ----------

# ----
# Ping Robot
ping = Button()
ping_2 = PythonScript(ip=panel_5, ping=ping)  # -> out, trigger
# ---------- ping_2: Python ----------
from scriptcontext import sticky as st
from ur_fabrication_control.direct_control.utilities import is_available

guid = str(ghenv.Component.InstanceGuid)
txt_key = "txt_" + guid
if txt_key not in st:
    st[txt_key] = ""

if ping:
    
    available = is_available(ip)
    
    if available:
        st[txt_key] = "%s is up!" % ip
        trigger = True
    else:
        st[txt_key] = "%s is down!" % ip
        trigger = False

print(st[txt_key])
# ---------- end ping_2 ----------
panel_6 = Panel(ping_2.out)

ghpython_script_5 = GhPythonScript(trajectory=trajectory)  # -> configs_list
# ---------- ghpython_script_5: Python ----------
from compas_robots import Configuration

def trajectory_points_to_configs(trajectory_points):
    configs = [] 
    for trajectory_point in trajectory_points:
        config = Configuration.from_revolute_values(trajectory_point.values())
        configs.append(config)
    return configs

points = trajectory.points

configs_list = trajectory_points_to_configs(points)
# ---------- end ghpython_script_5 ----------
pick_and_place = GhPythonScript(
    motion_trajectory_configs=ghpython_script_5,
    speed=Slider(0.1, range=0..1),
    accel=Slider(0.04, range=0..3.14),
    radius=Slider(0.006, range=0..3.14),
    send=Button(),
    ip=panel_5)  # inputs motion_trajectory_configs: list
# ---------- pick_and_place: Python ----------
import os
import math
import time
from scriptcontext import sticky as st
import Grasshopper.Kernel as gh
from compas.rpc import Proxy
from compas.geometry import Translation, Vector, Transformation, Frame

vaccum_io = 5
package_path = ghdoc.Path
#send_trajectory_key = 'send_trajectory_key' + send_topic_name

#print send
#print st[send_trajectory_key]

#Check if value is true and sticky of the value has been updated
if send:
    if not motion_trajectory_configs: #if configs provided, then display message
        ghenv.Component.Message = "No trajectory to move to!"

    else:
        
        canvas = ghenv.Component.OnPingDocument()
        path = os.path.abspath(os.path.join(package_path,"../fabrication", "control"))
        rtde = Proxy('fabrication', path=path)
        rtde.send_configs_list(motion_trajectory_configs, speed, accel, radius, ip)

        ghenv.Component.Message = "Sent frames" #display message on component
#        a = st['send_trajectory_key']

else:
            ghenv.Component.Message = "Send has not been received yet" #display message on component = "Send has not been received yet"
# ---------- end pick_and_place ----------

# ----
# Send single target frame using UR RTDE
# Pick & Place
number_slider_6 = Slider(0.1, range=0..3.14)
move_to_target = GhPythonScript(speed=Slider(0.02, range=0..2), accel=number_slider_6, send=Button(), ip=panel_5)
# ---------- move_to_target: Python ----------
import os
import math
from compas.rpc import Proxy

package_path = ghdoc.Path

if send:
    if not frame:
        ghenv.Component.Message = "No frame to move to!"
    else:
        canvas = ghenv.Component.OnPingDocument()
        path = os.path.abspath(os.path.join(package_path,"../fabrication", "control"))
        rtde = Proxy('fabrication', path=path)
        radius = 0.01
        a = rtde.move_to_target(frame, speed, accel, radius, ip=ip)
        ghenv.Component.Message = "Sent frame"
# ---------- end move_to_target ----------

# ----
# Send to a config using UR RTDE
number_slider_7 = Slider(0.03, range=0..2)
move_to_config = GhPythonScript(config=ghpython_script_3, speed=number_slider_7, accel=Slider(0.1, range=0..3.14), send=Button(), ip=panel_5)  # -> a
# ---------- move_to_config: Python ----------
import os
import math

from compas.rpc import Proxy
package_path = ghdoc.Path

if send:
    if not config:
        ghenv.Component.Message = "No config to move to!"
    else:
        canvas = ghenv.Component.OnPingDocument()
        path = os.path.abspath(os.path.join(package_path,"../fabrication", "control"))
        rtde = Proxy('fabrication', path=path)
        nowait = True
        a = rtde.move_to_joints(config, speed, accel, nowait, ip=ip)
        ghenv.Component.Message = "Sent config"
# ---------- end move_to_config ----------

pick_and_place_2 = GhPythonScript(
    pick_trajectory=pick_trajectory,
    move_trajectory=move_trajectory,
    place_trajectory=place_trajectory,
    speed=number_slider_2,
    accel=number_slider_3,
    radius=number_slider_4,
    send=Button(),
    ip=panel_5)  # inputs pick_trajectory: list, move_trajectory: list, place_trajectory: list, io: Int32
# ---------- pick_and_place_2: Python ----------
import os
import math
import time
from scriptcontext import sticky as st
import Grasshopper.Kernel as gh
from compas.rpc import Proxy
from compas.geometry import Translation, Vector, Transformation, Frame

def trajectory_points_to_configs(trajectory_points):
    configs = [] 
    for trajectory_point in trajectory_points:
        config = Configuration(trajectory_point.joint_values, trajectory_point.joint_types, trajectory_point.joint_names)
        configs.append(config)
    return configs

package_path = ghdoc.Path

#Check if value is true and sticky of the value has been updated
if send:
    if not pick_trajectory: #if no frames provided, then display message
        ghenv.Component.Message = "No pick trajectory to move to!"
    
    if not move_trajectory: #if no frames provided, then display message
        ghenv.Component.Message = "No move trajectory to move to!"
    
    if not place_trajectory: #if no frames provided, then display message
        ghenv.Component.Message = "No place trajectory to move to!"
    
    else:
        
        canvas = ghenv.Component.OnPingDocument()
        path = os.path.abspath(os.path.join(package_path,"../fabrication", "control"))
        rtde = Proxy('fabrication', path=path)
        pick_configs = trajectory_points_to_configs(pick_trajectory.points)
        move_configs = trajectory_points_to_configs(move_trajectory.points)
        place_configs = trajectory_points_to_configs(place_trajectory.points)
        
        rtde.pick_and_place_jk(pick_configs, move_configs, place_configs, speed, accel, radius, ip, vaccum_io)
        ghenv.Component.Message = "Sent frames" #display message on component
#        a = st['send_trajectory_key']

else:
            ghenv.Component.Message = "Send has not been received yet" #display message on component = "Send has not been received yet"
# ---------- end pick_and_place_2 ----------

pick_and_place_3 = GhPythonScript(
    pick_trajectory=pick_trajectory,
    move_trajectory=move_trajectory,
    place_trajectory=place_trajectory,
    speed=number_slider_2,
    accel=number_slider_3,
    radius=number_slider_4,
    send=Button(),
    ip=panel_5)  # inputs pick_trajectory: list, move_trajectory: list, place_trajectory: list, io: Int32
# ---------- pick_and_place_3: Python ----------
import os
import math
import time
from scriptcontext import sticky as st
import Grasshopper.Kernel as gh
from compas.rpc import Proxy
from compas.geometry import Translation, Vector, Transformation, Frame

def trajectory_points_to_configs(trajectory_points):
    configs = [] 
    for trajectory_point in trajectory_points:
        config = Configuration(trajectory_point.joint_values, trajectory_point.joint_types, trajectory_point.joint_names)
        configs.append(config)
    return configs

package_path = ghdoc.Path

#Check if value is true and sticky of the value has been updated
if send:
    if not pick_trajectory: #if no frames provided, then display message
        ghenv.Component.Message = "No pick trajectory to move to!"
    
    if not move_trajectory: #if no frames provided, then display message
        ghenv.Component.Message = "No move trajectory to move to!"
    
    if not place_trajectory: #if no frames provided, then display message
        ghenv.Component.Message = "No place trajectory to move to!"
    
    else:
        
        canvas = ghenv.Component.OnPingDocument()
        path = os.path.abspath(os.path.join(package_path,"../fabrication", "control"))
        rtde = Proxy('fabrication', path=path)
        pick_configs = trajectory_points_to_configs(pick_trajectory.points)
        move_configs = trajectory_points_to_configs(move_trajectory.points)
        place_configs = trajectory_points_to_configs(place_trajectory.points)
        
        rtde.exit_pick_and_place_jk(pick_configs, move_configs, place_configs, speed, accel, radius, ip, vaccum_io)
        ghenv.Component.Message = "Sent frames" #display message on component
#        a = st['send_trajectory_key']

else:
            ghenv.Component.Message = "Send has not been received yet" #display message on component = "Send has not been received yet"
# ---------- end pick_and_place_3 ----------

# ----
# Toggle freedrive to move robot
boolean_toggle = BooleanToggle(True)  # disabled
boolean_toggle_2 = BooleanToggle(False)  # disabled
toggle_freedrive = GhPythonScript(ip=panel_5, start_teach_mode=boolean_toggle, stop_teach_mode=boolean_toggle_2)  # -> a; disabled
# ---------- toggle_freedrive: Python ----------
import os
import math

from compas.rpc import Proxy
package_path = ghdoc.Path
path = os.path.abspath(os.path.join(package_path,"../robot"))

if start_teach_mode:   
    canvas = ghenv.Component.OnPingDocument()
    path = os.path.abspath(os.path.join(package_path,"../fabrication", "control"))
    rtde = Proxy('fabrication', path=path)                         # stay in teach moded(freedrive) as long as this is True
    a = rtde.start_teach_mode(ip=ip)            # send message to robot
    ghenv.Component.Message = "Freedrive on"    # display message on GH component

if stop_teach_mode:   
    canvas = ghenv.Component.OnPingDocument()
    print (path)
    rtde = Proxy('fabrication', path=path)                          # stop teach mode if stop button pressed
    a = rtde.stop_teach_mode(ip=ip)             # send message to robot   
    ghenv.Component.Message = "Freedrive off"   # display message on GH component
# ---------- end toggle_freedrive ----------

# ----
# Get Current Config
button_2 = Button()
get_config_2 = GhPythonScript(robot=robot_4, send=button_2, ip=panel_5)  # -> config, frame
# ---------- get_config_2: Python ----------
import os
from scriptcontext import sticky as st
#sticky is a persistent dictionary which can save values and also be acessed by other GH components
#we use it here with a custom key to store values we read from the robot
from compas.rpc import Proxy
from compas.geometry import Frame
package_path = ghdoc.Path

config_key = 'config_{}'.format(str(ghenv.Component.InstanceGuid))
new_key = 'new_key_{}'.format(str(ghenv.Component.InstanceGuid))
frame_key = 'frame_{}'.format(str(ghenv.Component.InstanceGuid))

if config_key not in st:
    st[config_key] = None

if frame_key not in st:
    st[frame_key] = None

if send:
    canvas = ghenv.Component.OnPingDocument()
    path = os.path.abspath(os.path.join(package_path,"../fabrication", "control"))
    print (path)
    rtde = Proxy('fabrication', path=path)
    
    st[config_key] = rtde.get_config(ip=ip)
    st[new_key] = rtde.get_config(ip=ip)
    st[frame_key] = robot.forward_kinematics(st[config_key], group, options=dict(solver='model'))
#    a = rtde.get_config(ip=ip)

config = st[config_key]
frame = st[frame_key]

#print "joint values: ", config.joint_values

#frame_WCF = frame_RCF.transformed(robot.transformation_BCF_WCF())
#print frame_RCF
# ---------- end get_config_2 ----------
draw_2 = Draw(cg=get_config_2.frame)  # -> rg; same code as draw
